# Grasshopper definition Laka-2x99-honeybee.gh (Grasshopper 1.0.8)

create_frame_element = HBPHCreatePHWindowFrameElement(name="Frame parameters", u_factor=Slider(0.6, range=0..1))  # -> out, frame_element; plug-in component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
shademat = HBShadeMaterial(name="Window shader", thickness=Slider(0.05, range=0..0.1), transmittance="0.37")  # -> mat; plug-in component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
create_frame = HBPHCreatePHWindowFrame(
    name="Frame",
    top=create_frame_element.frame_element,
    right=create_frame_element.frame_element,
    bottom=create_frame_element.frame_element,
    left=create_frame_element.frame_element)  # -> out, frame; plug-in component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
create_glazing = HBPHCreatePHGlazing(name="Glazing", u_factor="0.62")  # -> out, glazing; plug-in component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
create_sd_const = HBPHCreateSDConstructions(const_names="roof", u_values="0.0946")  # -> out, hb_constructions; inputs const_names: list, u_values: list; plug-in component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
create_sd_const_2 = HBPHCreateSDConstructions(const_names="ground floor", u_values="0.284")  # -> out, hb_constructions; inputs const_names: list, u_values: list; plug-in component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
# Constructions
create_sd_const_3 = HBPHCreateSDConstructions(const_names="ext wall", u_values="0.142")  # -> out, hb_constructions; inputs const_names: list, u_values: list; plug-in component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
create_ph_win_const = HBPHCreatePHWindowConstruction(name="Window", frame=create_frame.frame, glazing=create_glazing.glazing, shade=shademat)  # -> out, construction; plug-in component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
subfacesubset = HBSubfaceSubset(window=create_ph_win_const.construction, glass_door=create_ph_win_const.construction)  # -> subface_set; plug-in component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
groundsubset = HBGroundConstructionSubset(ground_floor=create_sd_const_2.hb_constructions)  # -> ground_set; plug-in component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
exteriorsubset = HBExteriorConstructionSubset(exterior_wall=create_sd_const_3.hb_constructions, exterior_roof=create_sd_const.hb_constructions)  # -> exterior_set; plug-in component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
ph_foundation_types = HBPHFoundationTypes({"1-Heated Basement": 1, "2-Unheated Basement": 2, "3-Slab-On-Grade": 3, "4-Vented Crawlspace": 4, "5-None": 5}, selected="3-Slab-On-Grade")
constructionset = HBConstructionSet(name="construction set", exterior_subset=exteriorsubset, ground_subset=groundsubset, subface_subset=subfacesubset)  # -> constr_set; plug-in component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
create_foundation = HBPHCreateFoundation(
    type=ph_foundation_types,
    display_name="slab",
    floor_slab_area_m2=Slider(99, range=0..100),
    floor_slab_u_value=Slider(0.3, range=0..1),
    floor_slab_exposed_perimeter_m=Slider(40, range=0..100))  # -> out, ph_foundation; inputs perim_insulation_position: Int32; plug-in component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
pipeline = GeometryPipeline(
    GroupByLayer=False,
    GroupByType=False,
    IncludeHidden=True,
    IncludeLocked=True,
    LayerFilter="Windows",
    NameFilter="*",
    SublayerFiltering=True,
    TypeFilter=1073741848)
pipeline_2 = GeometryPipeline(
    GroupByLayer=False,
    GroupByType=False,
    IncludeHidden=True,
    IncludeLocked=True,
    LayerFilter="Geometry",
    NameFilter="*",
    SublayerFiltering=True,
    TypeFilter=1073741848)
# GEOMETRY
roomsolid = HBRoomFromSolid(geo=flatten(pipeline_2), constr_set=constructionset, conditioned=True)  # -> report, rooms; plug-in component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
aperture = HBAperture(geo=pipeline)  # -> report, apertures; plug-in component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
solveadj = HBSolveAdjacency(rooms=flatten(roomsolid.rooms), run=Toggle(True))  # -> report, adj_rooms; plug-in component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
pipeline_3 = GeometryPipeline(
    GroupByLayer=False,
    GroupByType=False,
    IncludeHidden=True,
    IncludeLocked=True,
    LayerFilter="TermBri",
    NameFilter="*",
    SublayerFiltering=True,
    TypeFilter=1073741852)
addsubface = HBAddSubface(hb_obj=flatten(solveadj.adj_rooms), sub_faces=flatten(aperture.apertures))  # -> hb_obj; plug-in component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
panel = Panel("""1
1
1
1
1
1
0
1
1
1
1
1""")
add_foundations = HBPHAddFoundations(ph_foundations=create_foundation.ph_foundation, hb_rooms=addsubface)  # -> out, hb_rooms; inputs ph_foundations: list, hb_rooms: list; plug-in component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
create_thermal_bridges = HBPHCreateThermalBridges(geometry=pipeline_3, names="Thermal Bridges", quantities=Slider(1, range=0..10))  # -> out, thermal_bridges; inputs geometry: list of GeometryBase, names: list, psi_values: list, fRsi_values: list, types: list, quantities: list; plug-in component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
cfm_extract = Panel("""0
0
0.0083
0.0083
0
0
0
0.0083
0.0083
0.0083
0.0083
0.0083""")
cfm_supply = Panel("""0.0083
0.0083
0
0
0.0083
0.0083
0.0083
0
0
0
0
0""")
pipeline_4 = GeometryPipeline(
    GroupByLayer=False,
    GroupByType=False,
    IncludeHidden=True,
    IncludeLocked=True,
    LayerFilter="Rooms",
    NameFilter="*",
    SublayerFiltering=True,
    TypeFilter=1073741848)
graft = GraftTree(Tree=panel, IncludeEmptyLists=True, IncludeNullItems=True)
add_thermal_bridges = HBPHAddThermalBridgesToRooms(thermal_bridges=create_thermal_bridges.thermal_bridges, hb_rooms=add_foundations.hb_rooms)  # -> out, hb_rooms; inputs thermal_bridges: list, hb_rooms: list; plug-in component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
objdet = ObjectDetails(Object=pipeline_4)  # -> Referenced, Available, Name, Layer, Colour, Guid
panel_2 = Panel(objdet.Name)
create_space_ph_vent = HBPHCreateSpacePHVentilation(v_sup=simplify(cfm_supply), v_eta=simplify(cfm_extract))  # -> out, simplify(space_ph_vent); inputs v_sup: tree, v_eta: tree, v_tran: tree; plug-in component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
graft_2 = GraftTree(Tree=objdet.Name, IncludeEmptyLists=True, IncludeNullItems=True)
# SPACES
graft_3 = GraftTree(Tree=pipeline_4, IncludeEmptyLists=True, IncludeNullItems=True)
set_spec_heat_cap = HBPHSetSpecHeatCapacity(room_spec_capacities=Slider(3, range=0..10), hb_rooms=add_thermal_bridges.hb_rooms)  # -> out, hb_rooms; inputs room_spec_capacities: list, hb_rooms: list; plug-in component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
graft_4 = GraftTree(Tree=create_space_ph_vent.space_ph_vent, IncludeEmptyLists=True, IncludeNullItems=True)
create_ph_spaces = HBPHCreateSpaces(
    flr_seg_geom=simplify(graft_3),
    weighting_factors=simplify(graft),
    space_names=simplify(graft_2),
    space_ph_vent_rates=simplify(graft_4))  # -> out, error, floor_breps, volume_breps, spaces; inputs flr_seg_geom: tree of GeometryBase, weighting_factors: tree, volume_geometry: tree, volume_heights: tree, space_names: tree, space_numbers: tree, space_ph_vent_rates: tree, flr_seg_net_areas: tree; plug-in component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
add_ph_spaces = HBPHAddSpaces(spaces=create_ph_spaces.spaces, inherit_room_names=False, hb_rooms=set_spec_heat_cap.hb_rooms)  # -> out, check_pts, open_rooms, hb_rooms; inputs spaces: list, inherit_room_names: Boolean, hb_rooms: list; plug-in component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
ph_op_period = HBPHOperationPeriod(hours_per_day=Slider(22, range=0..100), operating_fraction=Slider(0.75, range=0..1))  # -> out, op_period; plug-in component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
# VENT SCH
ph_op_period_2 = HBPHOperationPeriod(hours_per_day=Slider(2, range=0..10), operating_fraction=Slider(1, range=0..1))  # -> out, op_period; plug-in component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
ph_vent_sched = HBPHVentSchedule(name="ventilation sched", op_period_high=ph_op_period_2.op_period, op_period_standard=ph_op_period.op_period)  # -> out, ventilation_sch; plug-in component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
applyroomsch = HBApplyRoomSchedules(room_or_program=flatten(add_ph_spaces.hb_rooms), ventilation_sch=ph_vent_sched.ventilation_sch)  # -> report, mod_obj; plug-in component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
hbph_cooling_types = HBPHCoolingTypes({"Ventilation Air": 1, "Recirculating Air": 2, "Dehumidification": 3, "Radiant Panel": 4}, selected="Radiant Panel")
pipeline_5 = GeometryPipeline(
    GroupByLayer=False,
    GroupByType=False,
    IncludeHidden=True,
    IncludeLocked=True,
    LayerFilter="ERV",
    NameFilter="*",
    SublayerFiltering=True,
    TypeFilter=1073741852)
hbph_heating_types = HBPHHeatingTypes({"Direct Electric": 1, "Boiler (Gas, Oil)": 2, "Boiler (Wood)": 3, "District Heating": 4, "Heat Pump (Annual)": 5, "Heat Pump (Monthly)": 6}, selected="Heat Pump (Annual)")
create_cooling_parameters = HBPHCreateCoolingParams(cooling_type=hbph_cooling_types, display_name="Ceiling cooler", annual_COP=Slider(3.3, range=0..10))  # -> out, cooling_params; plug-in component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
# MECHANICAL VENTILATION
hbph_vent_types = HBPHVentTypes({"1-Balanced PH ventilation with HR [Default]": "1", "2-Extract air unit": "2", "3-Only window ventilation": "3"}, selected="1-Balanced PH ventilation with HR [Default]")
create_duct = HBPHCreateVentilationDuct(geometry=pipeline_5, insul_thickness=Slider(50, range=0..100))  # -> out, vent_duct; inputs geometry: list of GeometryBase, insul_reflective: Boolean; plug-in component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
create_heating_cooling = HBPHCreateSpaceConditioningSystem(
    system_type=hbph_heating_types,
    display_name="Main Heat Pump",
    annual_COP=Slider(3.5, range=0..10),
    cooling_params_chilled_panel=create_cooling_parameters.cooling_params)  # -> out, space_conditioning_system; plug-in component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
ph_ventilator = HBPHVentilator(display_name="Zender ComfoAir Q600 ERV", sensible_hr="0.8", latent_hr="0.68", elec_efficiency="0.22")  # -> out, flatten(unit); inputs frost_protection: Boolean, inside: Boolean; plug-in component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
create_vent = HBPHCreateVentilationSystem(
    system_name="balanced PH with HR",
    system_type=hbph_vent_types,
    vent_unit=ph_ventilator.unit,
    duct_01=create_duct.vent_duct,
    duct_02=create_duct.vent_duct)  # -> out, vent_system; inputs duct_01: list, duct_02: list; plug-in component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
add_mech = HBPHAddMechSystems(
    ventilation_system=create_vent.vent_system,
    space_conditioning_systems=flatten(create_heating_cooling.space_conditioning_system),
    hb_rooms=applyroomsch.mod_obj)  # -> out, hb_rooms; inputs space_conditioning_systems: list, supportive_devices: list, hb_rooms: list; plug-in component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
hbph_shw_heater_types = HBPHSHWHeaterTypes({"Elec. Resistance": "1-Electric", "Boiler (gas/oil)": "2-Boiler (gas/oil)", "Boiler (wood)": "3-Boiler (wood)", "District Heating": "4-District", "Heat Pump (annual COP)": "5-HeatPump (annual COP)", "Heat Pump (monthly COP)": "6-HeatPump (monthly COP)", "Heat Pump (inside)": "7-HeatPump (inside)"}, selected="Heat Pump (annual COP)")
hbph_shw_pipe_material = HBPHSHWPipeMaterial({"1-COPPER_M": 1, "2-COPPER_L": 2, "3-COPPER_K": 3, "4-CPVC_CTS_SDR": 4, "5-CPVC_SCH_40": 5, "6-PEX": 6, "7-PE": 7, "8-PEX_CTS_SDR": 8}, selected="1-COPPER_M")
pipeline_6 = GeometryPipeline(
    GroupByLayer=False,
    GroupByType=False,
    IncludeHidden=True,
    IncludeLocked=True,
    LayerFilter="Pipe",
    NameFilter="*",
    SublayerFiltering=True,
    TypeFilter=1073741852)
hbph_shw_pipe_diameter = HBPHSHWPipeDiameter({"3/8": 1, "1/2": 2, "5/8": 3, "3/4": 4, "1": 5, "1-1/4": 6, "1-1/2": 7, "2": 8}, selected="1/2")
toggle = BooleanToggle(True)
hbph_shw_pipe_diameter_2 = HBPHSHWPipeDiameter({"3/8": 1, "1/2": 2, "5/8": 3, "3/4": 4, "1": 5, "1-1/4": 6, "1-1/2": 7, "2": 8}, selected="3/8")
pipeline_7 = GeometryPipeline(
    GroupByLayer=False,
    GroupByType=False,
    IncludeHidden=True,
    IncludeLocked=True,
    LayerFilter="Pipe",
    NameFilter="*",
    SublayerFiltering=True,
    TypeFilter=1073741852)
create_shw_tank = HBPHCreateSHWTank(tank_type=Slider(2, range=0..10), display_name="Hot Water", in_conditioned_space=toggle)  # -> out, storage_tank; inputs quantity: Int32, for_solar: Boolean, in_conditioned_space: Boolean; plug-in component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
create_recirc_pipes = HBPHCreateSHWRecirculationPipes(geometry=pipeline_6, name="Hot Water", diameter=hbph_shw_pipe_diameter)  # -> out, flatten(dhw_recirc_piping); inputs geometry: list of GeometryBase, name: list, diameter: list, insul_thickness: list, insul_conductivity: list, insul_reflective: list of Boolean, insul_quality: list, daily_period: list, water_temp: list; plug-in component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
# HOT WATER
create_shw_heater = HBPHCreateSHWHeater(
    heater_type=hbph_shw_heater_types,
    display_name="Hot Water",
    in_conditioned_space=toggle,
    annual_COP=Slider(3.3, range=0..10),
    total_system_perf_ratio=Slider(0.7, range=0..1))  # -> out, heater; inputs in_conditioned_space: Boolean; plug-in component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
create_trunk_pipes = HBPHCreateSHWPipeTrunks(display_name="pipe", material=hbph_shw_pipe_material, diameter=hbph_shw_pipe_diameter_2, geometry=pipeline_7)  # -> out, dhw_trunk_piping; inputs dhw_branches: list, multiplier: list of Int32, display_name: list, demand_recirculation: list of Boolean, material: list, diameter: list, water_temp: list, geometry: list of GeometryBase; plug-in component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
panel_3 = Panel("https://climate.onebuilding.org/WMO_Region_6_Europe/BGR_Bulgaria/BR_Burgas/BGR_BR_Burgas.AP.156550_TMYx.zip")
create_shw_sys = HBPHCreateSHWSystem(
    name="Hot Water",
    tank_1=create_shw_tank.storage_tank,
    heaters=create_shw_heater.heater,
    distribution_piping=create_trunk_pipes.dhw_trunk_piping,
    recirc_piping=create_recirc_pipes.dhw_recirc_piping)  # -> out, hb_shw; inputs heaters: list, distribution_piping: list, num_tap_points: Int32, recirc_piping: list; plug-in component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
apply_shw_sys = HBPHApplySHWSystem(hb_shw=create_shw_sys.hb_shw, hb_rooms=add_mech.hb_rooms)  # -> out, flatten(hb_rooms); inputs hb_rooms: list; plug-in component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
bang = ExplodeTree(Data=graft(apply_shw_sys.hb_rooms))  # -> simplify(Branch0), simplify(Branch1)
downloadepw = LBDownloadWeather(weather_URL=panel_3)  # -> epw_file, stat_file, ddy_file; plug-in component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
# Occupancy
set_res_occupancy = HBPHSetResOccupancy(
    num_bedrooms=simplify(Slider(2, range=0..10)),
    num_dwellings=simplify(Slider(1, range=0..10)),
    num_people=simplify(Slider(3, range=0..10)),
    hb_rooms=simplify(bang.Branch0))  # -> out, hb_rooms; inputs num_bedrooms: tree of Int32, num_dwellings: tree of Int32, num_people: tree of Int32, hb_rooms: tree; plug-in component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
importepw = LBImportEPW(epw_file=downloadepw.epw_file)  # -> location, dry_bulb_temperature, dew_point_temperature, relative_humidity, wind_speed, wind_direction, direct_normal_rad, diffuse_horizontal_rad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; plug-in component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
arithop = LBArithmeticOperation(data_1=importepw.global_horizontal_rad, data_2=Slider(1000, range=0..1000), operator="/")  # -> data; plug-in component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
dirsolar = LBDirectionalSolarIrradiance(
    location=importepw.location,
    direct_norm=importepw.direct_normal_rad,
    diffuse_horiz=importepw.diffuse_horizontal_rad,
    srf_azimuth="180")  # -> report, total, direct, diff, reflect; plug-in component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
dirsolar_2 = LBDirectionalSolarIrradiance(
    location=importepw.location,
    direct_norm=importepw.direct_normal_rad,
    diffuse_horiz=importepw.diffuse_horizontal_rad,
    srf_azimuth="0")  # -> report, total, direct, diff, reflect; plug-in component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
dirsolar_3 = LBDirectionalSolarIrradiance(
    location=importepw.location,
    direct_norm=importepw.direct_normal_rad,
    diffuse_horiz=importepw.diffuse_horizontal_rad,
    srf_azimuth="90")  # -> report, total, direct, diff, reflect; plug-in component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
dirsolar_4 = LBDirectionalSolarIrradiance(
    location=importepw.location,
    direct_norm=importepw.direct_normal_rad,
    diffuse_horiz=importepw.diffuse_horizontal_rad,
    srf_azimuth="270")  # -> report, total, direct, diff, reflect; plug-in component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
merge = Merge(Data1=set_res_occupancy.hb_rooms, Data2=bang.Branch1)  # -> flatten(Result)
timeop = LBTimeIntervalOperation(data=arithop)  # -> daily, monthly, mon_per_hr; plug-in component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
panel_4 = Panel(importepw.location)
timeop_2 = LBTimeIntervalOperation(data=importepw.dry_bulb_temperature)  # -> daily, monthly, mon_per_hr; plug-in component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
xdata = LBDeconstructData(data=importepw.ground_temperature)  # -> header, values; plug-in component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
timeop_3 = LBTimeIntervalOperation(data=importepw.dew_point_temperature)  # -> daily, monthly, mon_per_hr; plug-in component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
timeop_4 = LBTimeIntervalOperation(data=dirsolar_4.total)  # -> daily, monthly, mon_per_hr; plug-in component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
timeop_5 = LBTimeIntervalOperation(data=dirsolar.total)  # -> daily, monthly, mon_per_hr; plug-in component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
timeop_6 = LBTimeIntervalOperation(data=dirsolar_2.total)  # -> daily, monthly, mon_per_hr; plug-in component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
timeop_7 = LBTimeIntervalOperation(data=dirsolar_3.total)  # -> daily, monthly, mon_per_hr; plug-in component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
# Appliances
panel_5 = Panel("1")
number_slider = Slider(41.1, range=0..100)
bang_2 = ExplodeTree(Data=xdata.values)  # -> Branch0, Branch1
add_ph_equipment = HBPHAddPHEquipment(phius_defaults=panel_5, hb_rooms=merge)  # -> out, flatten(hb_rooms); inputs phius_defaults: Int32, phi_defaults: Int32, equipment: list, hb_rooms: list; plug-in component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
xdata_2 = LBDeconstructData(data=timeop_3.monthly)  # -> header, values; plug-in component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
xdata_3 = LBDeconstructData(data=timeop.monthly)  # -> header, values; plug-in component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
xdata_4 = LBDeconstructData(data=timeop_2.monthly)  # -> header, values; plug-in component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
xdata_5 = LBDeconstructData(data=timeop_4.monthly)  # -> header, values; plug-in component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
xdata_6 = LBDeconstructData(data=timeop_5.monthly)  # -> header, values; plug-in component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
xdata_7 = LBDeconstructData(data=timeop_6.monthly)  # -> header, values; plug-in component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
xdata_8 = LBDeconstructData(data=timeop_7.monthly)  # -> header, values; plug-in component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
ph_location = HBPHPHLocation(
    display_name="Sarafovo",
    latitude=Slider(42.57, range=0..100),
    longitude=Slider(27.52, range=0..100),
    site_elevation=number_slider,
    hours_from_UTC=Slider(2, range=0..10))  # -> out, location; plug-in component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
ph_monthly_temps = HBPHPHClimateMonthlyTemps(air_temps=xdata_4.values, dewpoints=xdata_2.values, ground_temps=bang_2.Branch0)  # -> out, monthly_temps; inputs air_temps: list, dewpoints: list, sky_temps: list, ground_temps: list; plug-in component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
ph_monthly_radiation = HBPHPHClimateMonthlyRadiation(north=xdata_7.values, east=xdata_8.values, south=xdata_6.values, west=xdata_5.values, global=xdata_3.values)  # -> out, monthly_radiation; inputs north: list, east: list, south: list, west: list, global: list; plug-in component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
timeop_8 = LBTimeIntervalOperation(data=importepw.wind_speed)  # -> daily, monthly, mon_per_hr; plug-in component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
number_slider_2 = Slider(10, range=0..10)
xdata_9 = LBDeconstructData(data=timeop_8.monthly)  # -> header, values; plug-in component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
# SEGMENT
path = FilePath("Z:\Laka99\DOVER_AFB_DE-mon.txt")
avr = Average(Input=xdata_9.values)
phi_cert = HBPHPHICertification(
    phpp_version=Slider(10, range=0..10),
    building_use_type=number_slider_2,
    certification_type=number_slider_2,
    retrofit=Slider(1, range=0..1))  # -> out, phi_certification; inputs phpp_version: Int32; plug-in component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
create_site_from_file = HBPHCreateSiteFromPhiusFile(source_file_path=path)  # -> out, site; plug-in component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
xdata_10 = LBDeconstructData(data=importepw.dry_bulb_temperature)  # -> header, values; plug-in component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
ph_peak_load = HBPHPHClimatePeakLoad(temp="-9", rad_global="61.05", sky_temp="18.3")  # -> out, peak_load; plug-in component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
ph_climate_data = HBPHPHClimateData(
    display_name="Sarafovo",
    station_elevation=number_slider,
    avg_wind_speed=avr,
    monthly_temps=ph_monthly_temps.monthly_temps,
    monthly_radiation=ph_monthly_radiation.monthly_radiation,
    peak_heat_load_1=ph_peak_load.peak_load)  # -> out, climate_data; plug-in component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
ph_site = HBPHPHSite(display_name="Sarafovo", location=ph_location.location, climate_data=ph_climate_data.climate_data)  # -> out, site; plug-in component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
ph_bldg_segment = HBPHBldgSegment(
    segment_name="Full house segment",
    num_floor_levels=Slider(2, range=0..10),
    num_dwelling_units=Slider(1, range=0..1),
    site=ph_site.site,
    phi_certification=phi_cert.phi_certification,
    hb_rooms=simplify(flatten(add_ph_equipment.hb_rooms)))  # -> out, hb_rooms; inputs num_floor_levels: Int32, num_dwelling_units: Int32, source_energy_factors: list, co2e_factors: list, hb_rooms: list; plug-in component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
bnd = Bounds(Numbers=xdata_10.values)
pipeline_8 = GeometryPipeline(
    GroupByLayer=False,
    GroupByType=False,
    IncludeHidden=True,
    IncludeLocked=True,
    LayerFilter="Shading",
    NameFilter="*",
    SublayerFiltering=True,
    TypeFilter=1073741848)
panel_6 = Panel(bnd)
shade = HBShade(geo=pipeline_8, name="Shade")  # -> report, shades; plug-in component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
# EXPORT
panel_7 = Panel("Laka99")
model = HBModel(rooms=flatten(ph_bldg_segment.hb_rooms), shades=flatten(shade.shades), name=panel_7)  # -> report, model; plug-in component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
path_2 = FilePath("Z:\Laka99\")
team_member = HBPHCreateProjectTeamMember(name="Zlatan Dimitrov", city="Burgas")  # -> out, team_member; plug-in component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
set_project_data = HBPHSetModelProjectData(owner=team_member.team_member, designer=team_member.team_member, model=model.model)  # -> out, model; plug-in component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
dumpobjects = HBDumpObjects(hb_objs=flatten(set_project_data.model), name="laka99_hbjson", folder=path_2, dump=Toggle(True))  # -> report, hb_file; plug-in component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
write_wufi_xml = HBPHWriteWUFIXML(filename=panel_7, save_folder=path_2, hb_json_file=dumpobjects.hb_file, write_xml=Toggle(True))  # -> out, xml_file; plug-in component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
